# Grasshopper definition BasicAddition.gh (Grasshopper 1.0.7)
# plug-ins: sof_gh_sofistik-2022

io = IO(
    SofistikDocumentProperties_VersionMajor="2022",
    SofistikDocumentProperties_VersionMinor="2",
    SofistikDocumentProperties_VersionName="2022")
B = GetInteger(Slider(5, range=0..20), AtLeast=1, AtMost=1, Maximum=2147483647, Minimum=-2147483648, Prompt="B")
A = GetInteger(Slider(17, range=0..20), AtLeast=1, AtMost=1, Maximum=2147483647, Minimum=-2147483648, Prompt="A")
C = GetInteger(Slider(7, range=0..20), AtLeast=1, AtMost=1, Maximum=2147483647, Minimum=-2147483648, Prompt="C")
addition = Addition(A=A, B=B, C=C)
out = GetInteger(addition, AtLeast=1, AtMost=1, Maximum=2147483647, Minimum=-2147483648, Prompt="Output")
panel = Panel(out)
